# Grasshopper definition udi_test.gh (Grasshopper 1.0.7)
# plug-ins: GH_CPython

panel = Panel("D:/y7s1/work/RA/DQN/full_package_2/game_interact_udi_2.csv")
trigger = Trigger(Interval=1000, TimerInterval=1000, Target=monitor)  # disabled
monitor = GH_CPython(file_path=panel, if_run=Toggle(False))  # -> a, b, c, run, countNum; inputs file_path: list, if_run: list
#   port file_path: [required] - [type = int] - [default = None] Descripe your input here * bullet point. * bullet point
# ---------- monitor: Python ----------
# -*- coding: utf-8 -*-
""" 
Python Script
Created on  Saturday November 2024 07:22:58 
@author:  kk722 

[desc]
Description of the plugin Here
Write here any thing... 
[/desc]

ARGUMENTS:
----------
<inp> 
    _input :[file_path] - [type = string] - [default = None] 

    _input :[if_run] - [type = bool] - [default = False] 
</inp>


RETURN:
----------
    <out>
        output_ : [a] - [type = int] 
    </out>
    <out>
        output_ : [b] - [type = int] 
    </out>
    <out>
        output_ : [c] - [type = int] 
    </out>
    <out>
        output_ : [run] - [type = bool] 
    </out>
    <out>
        output_ : [countNum] - [type = int] 
    </out>

"""
import pandas as pd
import time
def read_last_row_factors(file_path):
    run = False
    attempts = 0
    max_attempts = 30
    while attempts < max_attempts:
        # Read the CSV file
        df = pd.read_csv(file_path)
        
        # Get the last row and check if factors are valid (non-string and not NaN)
        last_row = df.iloc[-1]
        factor_1, factor_2, factor_3, countNum = last_row['Factor_1'], last_row['Factor_2'], last_row['Factor_3'],last_row['countNum']
   
        if pd.notna(factor_1) and pd.notna(factor_2) and pd.notna(factor_3):
            # Ensure values are int or float by checking their types
            if isinstance(factor_1, (int, float)) and isinstance(factor_2, (int, float)) and isinstance(factor_3, (int, float)):
                run = True
                a1 = int(factor_1)
                b1 = int(factor_2)
                c1 = int(factor_3)
                return a1, b1, c1, run, countNum
            elif factor_1 == "done" :
                run = False
                break
        
        # Wait 2 seconds before trying again
        time.sleep(0.5)
        attempts += 1

    # If max attempts reached and still no valid values, raise an error
    raise ValueError("Error: Valid factors not found after multiple attempts.")


# Main
if if_run==True:
  a, b, c, run, countNum = read_last_row_factors(file_path)
# ---------- end monitor ----------
panel_2 = Panel(monitor.a)
integer = Integer(monitor.c)
integer_2 = Integer(monitor.b)
integer_3 = Integer(monitor.a)
panel_3 = Panel("D:/y7s1/work/RA/DQN/full_package_2/udi_data.csv")
cluster = Cluster_14(miankuan=integer_3, yangtaijinshen=integer_2, yangtaiboli=integer, run=monitor.run)
gh_cpython = GH_CPython(udi=cluster, run=monitor.run)  # -> mean, run; inputs udi: list, run: list
# ---------- gh_cpython: Python ----------
# -*- coding: utf-8 -*-
""" 
Python Script
Created on  Tuesday October 2024 02:54:08 
@author:  kk722 

[desc]
Description of the plugin Here
Write here any thing... 
[/desc]

ARGUMENTS:
----------
<inp> 
    _input :[udi] - [type = int] - [default = 0] 
    Descripe your input here 
        * bullet point.
        * bullet point
</inp>
<inp>
    _input :[run] - [type = bool] - [default = false] 
</inp>

RETURN:
----------
    <out>
        output_ : [mean] - [type = float]
    </out>
    <out>
        output_ : [run] - [type = bool]
    </out>

"""
#udi= [1,2,3]
# Example array
array = udi

# Calculate the mean
mean = sum(array) / len(array)
print("Mean:", mean)
run = True
# ---------- end gh_cpython ----------
feeding = Feeding(mean=gh_cpython.mean, file_path=panel, countNum=monitor.countNum, run=gh_cpython.run)  # inputs mean: list, file_path: list, countNum: list, run: list
#   port mean: [required] - [type = int] - [default = None] Descripe your input here * bullet point. * bullet point
# ---------- feeding: Python ----------
# -*- coding: utf-8 -*-
""" 
Python Script
Created on  Saturday November 2024 07:25:40 
@author:  kk722 

[desc]
Description of the plugin Here
Write here any thing... 
[/desc]

ARGUMENTS:
----------
<inp> 
    _input :[mean] - [type = float] - [default = None] 
</inp>
<inp> 
    _input :[file_path] - [type = string] - [default = None] 
</inp>
<inp> 
    _input :[countNum] - [type = int] - [default = None] 
</inp>
<inp> 
    _input :[run] - [type = bool] - [default = False] 
</inp>
RETURN:
----------
    <out>
        output_ : indicate your output description here. \n refers to a new line.
    </out>

"""
import pandas as pd

def write_mean_to_last_row(file_path, mean_value):

    df = pd.read_csv(file_path)
    
    df.at[countNum-1,'Mean'] = mean_value
    
    df.to_csv(file_path, index=False)

# Main
if run == True: 
  write_mean_to_last_row(file_path, mean)
  print("Mean value updated successfully.")
# ---------- end feeding ----------
panel_4 = Panel(cluster)
udi_data_old = GH_CPython(udi=cluster, run=monitor.run, file_path=panel_3)  # inputs udi: list, run: list, file_path: list
# ---------- udi_data_old: Python ----------
# -*- coding: utf-8 -*-
""" 
Python Script
Created on  Tuesday October 2024 02:54:08 
@author:  kk722 

[desc]
Description of the plugin Here
Write here any thing... 
[/desc]

ARGUMENTS:
----------
<inp> 
    _input :[udi] - [type = int] - [default = 0] 
    Descripe your input here 
        * bullet point.
        * bullet point
</inp>
<inp>
    _input :[run] - [type = bool] - [default = false] 
</inp>
<inp>
    _input :[file_path] - [type = string] - [default = None] 
</inp>

RETURN:
----------
    <out>
        output_ : indicate your output description here. \n refers to a new line.
    </out>

"""
#udi= [1,2,3]

import csv
import os

csv_file_path = file_path

if run:

    if os.path.exists(csv_file_path):

        with open(csv_file_path, 'r') as csvfile:
            reader = list(csv.reader(csvfile))
        

        current_row_count = len(reader) - 1 


        new_column_header = f'UDI Run {len(reader[0])}'
        reader[0].append(new_column_header)
    

        for i in range(max(current_row_count, len(udi))):
            if i < current_row_count:

                if i < len(udi):
                    reader[i + 1].append(udi[i])
                else:
                    reader[i + 1].append("")
            else:

                new_row = ["" for _ in range(len(reader[0]) - 1)] 
                new_row.append(udi[i])
                reader.append(new_row)
    else:

        reader = [['UDI Run 1']] 
        for value in udi:
            reader.append([value])


    with open(csv_file_path, 'w', newline='') as csvfile:
        writer = csv.writer(csvfile)
        writer.writerows(reader)

    print("New UDI column added to {}".format(csv_file_path))
else:
    print("Data not saved because 'run' is set to False")
# ---------- end udi_data_old ----------
udi_data = GH_CPython(udi=cluster, run=monitor.run, file_path=panel_3)  # inputs udi: list, run: list, file_path: list; disabled
# ---------- udi_data: Python ----------
# -*- coding: utf-8 -*-
""" 
Python Script
Created on  Tuesday October 2024 02:54:08 
@author:  kk722 

[desc]
Description of the plugin Here
Write here any thing... 
[/desc]

ARGUMENTS:
----------
<inp> 
    _input :[udi] - [type = int] - [default = 0] 
    Descripe your input here 
        * bullet point.
        * bullet point
</inp>
<inp>
    _input :[run] - [type = bool] - [default = false] 
</inp>
<inp>
    _input :[file_path] - [type = string] - [default = None] 
</inp>

RETURN:
----------
    <out>
        output_ : indicate your output description here. \n refers to a new line.
    </out>

"""
# Example UDI list
#udi = [1, 2, 3]

import csv
import os

csv_file_path = file_path  # Ensure this is defined earlier in your code

if run:
    # Check if the CSV file already exists
    if os.path.exists(csv_file_path):
        # Open the file to read the existing content
        with open(csv_file_path, 'r') as csvfile:
            reader = list(csv.reader(csvfile))
        
        # Determine the current row count (excluding the header)
        current_row_count = len(reader) - 1 

        # Define a new header for the UDI column
        new_column_header = f'UDI Run {len(reader[0])}'
        reader[0].append(new_column_header)  # Add the new header to the first row

        # Add UDI data to each row or create new rows if necessary
        for i in range(max(current_row_count, len(udi))):
            if i < current_row_count:
                # Append UDI value if it exists, else append an empty string
                reader[i + 1].append(udi[i] if i < len(udi) else "")
            else:
                # Create a new row with empty values and the UDI value
                new_row = ["" for _ in range(len(reader[0]) - 1)]
                new_row.append(udi[i])
                reader.append(new_row)

        # Calculate the mean of the new UDI column, excluding empty strings
        udi_values = [float(row[-1]) for row in reader[1:] if row[-1] != ""]
        udi_mean = sum(udi_values) / len(udi_values) if udi_values else 0

        # Insert the mean value in the first row of the new UDI column
        reader[0][-1] = f"UDI Mean: {udi_mean:.2f}"
        
    else:
        # If the file doesn't exist, initialize it with the UDI data
        reader = [['UDI Run 1', f'UDI Mean: {sum(udi) / len(udi):.2f}']]  # Initialize header with mean
        for value in udi:
            reader.append([value])

    # Write the updated data back to the CSV file
    with open(csv_file_path, 'w', newline='') as csvfile:
        writer = csv.writer(csvfile)
        writer.writerows(reader)

    print("New UDI column added to {}".format(csv_file_path))
else:
    print("Data not saved because 'run' is set to False")
# ---------- end udi_data ----------

# ==== cluster Cluster_14

卫生间窗台高 = Slider(14, range=13..16)
卫生间宽 = Slider(12, range=11..16)
入口门位置 = Slider(0, range=0..1)
单间进深 = Slider(52, range=51..73)
卫生间进深 = Slider(19, range=18..22)
卫生间窗宽 = Slider(6, range=6..11)

miankuan = ClusterInput()
yangtaijinshen = ClusterInput()
yangtaiboli = ClusterInput()
model_builder = Model_builder(x=miankuan, x_2=单间进深, x_3=yangtaijinshen, x_4=yangtaiboli, x_5=卫生间进深, x_6=卫生间宽, relay=入口门位置, x_7=卫生间窗宽, x_8=卫生间窗台高)

# ---- group: 宿舍单元模型
model = Geometry(model_builder)

# ----
number_slider = Slider(0.2, range=0..1)
number_slider_2 = Slider(0.3, range=0..1)
number_slider_3 = Slider(0.2, range=0..1)

# ---- group: floor
list_item = ListItem(List=model, Index=Slider(1, range=0..2), Wrap=True)

# ---- group: ceiling
list_item_2 = ListItem(List=model, Index=Slider(2, range=0..2), Wrap=True)

# ---- group: wall
list_item_3 = ListItem(List=model, Index=Slider(0, range=0..100), Wrap=True)

# ----
genpts = LBGeneratePointGrid(geometry=list_item, grid_size=Slider(0.2, range=0..1))  # -> simplify(points), simplify(vectors), simplify(face_areas), mesh; plug-in component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
opaquemod3 = HBOpaqueModifier3(r_ref=number_slider_3, g_ref=number_slider_3, b_ref=number_slider_3)  # -> modifier; plug-in component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
opaquemod3_2 = HBOpaqueModifier3(r_ref=number_slider, g_ref=number_slider, b_ref=number_slider)  # -> modifier; plug-in component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
opaquemod3_3 = HBOpaqueModifier3(r_ref=number_slider_2, g_ref=number_slider_2, b_ref=number_slider_2)  # -> modifier; plug-in component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
face = HBFace(geo=list_item_3, rad_mod=opaquemod3)  # -> out, faces; plug-in component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
face_2 = HBFace(geo=list_item, rad_mod=opaquemod3_2)  # -> out, faces; plug-in component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
face_3 = HBFace(geo=list_item_2, rad_mod=opaquemod3_3)  # -> out, faces; plug-in component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
sensorgrid = HBSensorGrid(positions=genpts.points, mesh=genpts.mesh)  # -> grid; plug-in component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
panel = Panel("D:\y7s1\work\RA\1013\CHN_Shanghai.Shanghai.583670_IWEC\CHN_Shanghai.Shanghai.583670_IWEC.epw")
merge = Merge(Data1=face.faces)
model_2 = HBModel(faces=flatten(merge))  # -> out, model; plug-in component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
wea = HBWeaFromEPW(epw_file=panel)  # -> wea; plug-in component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
assigngridsviews = HBAssignGridsAndViews(model=model_2.model, grids=flatten(sensorgrid))  # -> model; plug-in component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
vizwiref = HBVisualizeWireframe(hb_objs=flatten(model_2.model))  # -> geo; plug-in component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
run = ClusterInput()
vector = Vector(Vector(0, 1, 0))
annualdaylight = HBAnnualDaylight(model=assigngridsviews, wea=wea, north=vector, enhanced=Toggle(True), run=run)  # -> out, results, DA, cDA, UDI, UDI_low, UDI_up; plug-in component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
udi = ClusterOutput(annualdaylight.UDI)
heatmap = LBSpatialHeatmap(values=annualdaylight.UDI, mesh=genpts.mesh)  # -> mesh, legend, title, colors, legend_par, vis_set; plug-in component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

# ==== cluster Model_builder
trigger = Trigger(Interval=5000, TimerInterval=5000, Target=counter)
increment = Slider(1, range=-2..3)
start = Slider(0, range=0..100)

# ---- group: 模型生成过程 / 阳台窗宽度
阳台窗宽_100 = Slider(1000, range=500..1000)

# ---- group: 模型生成过程
外墙厚_2 = Slider(100, range=0..100)
厕所墙厚_2 = Slider(60, range=0..100)

# ----
# 修改宿舍模型的各项设计参数
x = ClusterInput()
x_2 = ClusterInput()
x_3 = ClusterInput()
x_4 = ClusterInput()
x_5 = ClusterInput()
x_6 = ClusterInput()
x_7 = ClusterInput()
x_8 = ClusterInput()
ghpython_script = GhPythonScript(x=x)  # -> a
# ---------- ghpython_script: Python ----------
__author__ = "SZW"
__version__ = "2024.07.25"

import rhinoscriptsyntax as rs
a = x * 100
# ---------- end ghpython_script ----------
ghpython_script_2 = GhPythonScript(x=x_2)  # -> a; same code as ghpython_script
ghpython_script_3 = GhPythonScript(x=x_3)  # -> a; same code as ghpython_script
ghpython_script_4 = GhPythonScript(x=x_4)  # -> a; same code as ghpython_script
ghpython_script_5 = GhPythonScript(x=x_5)  # -> a; same code as ghpython_script
ghpython_script_6 = GhPythonScript(x=x_6)  # -> a; same code as ghpython_script
ghpython_script_7 = GhPythonScript(x=x_7)  # -> a; same code as ghpython_script
ghpython_script_8 = GhPythonScript(x=x_8)  # -> a; same code as ghpython_script

# ---- group: 模型生成过程 / 室内随机
水平定位 = Slider(0.5, range=0..1)
遮阳高度 = Slider(0.02, range=0..0.4)
放缩 = Slider(0.63, range=0.6..1)
垂直定位 = Slider(0.4, range=0..1)
z轴比例 = Slider(0.81, range=0.5..0.99)
x轴比例 = Slider(0.87, range=0.5..0.99)
门的位置 = Slider(0.4, range=0..1)

# ----
relay = ClusterInput()
merge = Merge(
    Data1=ghpython_script,
    Data2=ghpython_script_2,
    Data3=ghpython_script_3,
    Data4=ghpython_script_4,
    Data5=ghpython_script_5,
    Data6=ghpython_script_6,
    Data7=relay,
    Data8=ghpython_script_7,
    Data9=ghpython_script_8)
mass_addition = MassAddition(Input=merge)  # -> Result, PartialResults
event_gate = EventGate(Data=mass_addition.Result)  # -> Data, IsNew
counter = ImprovedDataRec(x=start, enable=event_gate.IsNew, reset=Button(), increment=increment)  # -> x; inputs x: Int32, enable: Boolean, reset: Boolean, increment: Int32
# ---------- counter: Python ----------
from Grasshopper import DataTree
if reset or 'rec' not in globals(): rec = x
if enable: rec = rec + increment  
x = rec
print x
# ---------- end counter ----------
eventswitch = EventGate(Data=counter)  # -> Data, IsNew
panel = Panel(counter)
panel_2 = Panel(eventswitch.Data)
addition = Addition(A="0", B=panel_2)  # -> flatten(Result)
panel_3 = Panel(addition)

# ---- group: 每个模型对应id
# 改变设计参数后 更新宿舍模型的id
sample_id = Data(flatten(addition))

# ----
galapagos = Galapagos()

# ---- group: 模型生成过程
# wc北面壁
y方向切分数量_1 = Slider(2, range=2..3)
x方向切分数量_1 = Slider(2, range=2..3)
x方向切分比例_1 = Slider(0.92, range=0.5..0.95)
层高 = Slider(3300, range=0..10000)
楼层数量 = Slider(13, range=5..20)
退界距离 = Slider(5, range=5..10)
y方向切分比例_1 = Slider(0.69, range=0.5..1)
底层内收距离 = Slider(1, range=0..3)
number_slider = Slider(0, range=0..100)
倒角半径 = Slider(0, range=0..3)
底层高度 = Slider(0, range=0..2, expression="x*3")
建筑类型1 = 建筑类型1(
    relay=楼层数量,
    relay_2=层高,
    relay_3=退界距离,
    relay_4=x方向切分数量_1,
    relay_5=x方向切分比例_1,
    relay_6=y方向切分数量_1,
    relay_7=y方向切分比例_1,
    倒角半径=倒角半径,
    底层高度=底层高度,
    底层内收距离=底层内收距离)  # -> geometry, extrusion
cap_holes = CapHoles(Brep=建筑类型1.geometry)
cap_holes_2 = CapHoles(Brep=建筑类型1.extrusion)
number_slider_2 = Slider(4, range=0..10)
scale = Scale(Geometry=cap_holes, Center=Point(0, 0, 0), Factor=Slider(0.001, range=0..0.001))  # -> Geometry, Transform
scale_2 = Scale(Geometry=cap_holes_2, Center=Point(0, 0, 0), Factor=Slider(0.001, range=0..0.001))  # -> Geometry, Transform
list_item = ListItem(List=cap_holes, Index=number_slider_2, Wrap=True)
cull_index = CullIndex(List=scale.Geometry, Indices=number_slider_2, Wrap=True)
list_item_2 = ListItem(List=flatten(scale_2.Geometry), Index=Slider(4, range=0..10), Wrap=True)
scale_3 = Scale(Geometry=list_item, Center=Point(0, 0, 0), Factor=Slider(0.001, range=0..0.001))  # -> Geometry, Transform
multiplication = Multiplication(A=sample_id, B=2)
multiplication_2 = Multiplication(A=sample_id, B=3)
multiplication_3 = Multiplication(A=sample_id, B=5)
multiplication_4 = Multiplication(A=sample_id, B=5)
multiplication_5 = Multiplication(A=sample_id, B=7)
cluster = Cluster_13(A=Slider(3300, range=0..10000), B=Slider(3900, range=0..10000), S=sample_id)
cluster_2 = Cluster_13(A=Slider(5100, range=0..10000), B=Slider(7300, range=0..10000), S=multiplication)
cluster_3 = Cluster_13(A=Slider(1200, range=0..10000), B=Slider(2000, range=0..10000), S=multiplication_2)
cluster_4 = Cluster_13(A=Slider(1800, range=0..10000), B=Slider(2200, range=0..10000), S=multiplication_3)
cluster_5 = Cluster_13(A=Slider(1100, range=0..10000), B=Slider(1600, range=0..10000), S=multiplication_4)
integer = Integer(cluster_5)
rectangle = Rectangle(Plane=PlaneXY(0, 0, 0), XSize=ghpython_script, YSize=ghpython_script_2, Radius=0)  # -> Rectangle, Length
unit_z = UnitZ(Factor=层高)
brep = Brep(rectangle.Rectangle)
area = Area(Geometry=rectangle.Rectangle)  # -> Area, Centroid
extrude = Extrude(Base=brep, Direction=unit_z)
offset_curve = OffsetCurve(Curve=rectangle.Rectangle, Plane=area.Centroid, Distance=外墙厚_2, BothSides=expr("-x", 外墙厚_2), Kinks=0, CapType=1)
cluster_6 = Cluster_12(brep=extrude)  # -> faces, index_2, y_component, maximum, index
member_index = MemberIndex(Set=cluster_6.y_component, Member=cluster_6.maximum)  # -> Index, Count
通风最大开窗比 = Slider(0.5, range=0..1)
cull_index_2 = CullIndex(List=cluster_6.faces, Indices=flatten([cluster_6.index_2, cluster_6.index]), Wrap=True)
list_item_3 = ListItem(List=cluster_6.faces, Index=member_index.Index, Wrap=True)
阳台窗宽最小_100 = Slider(1000, range=0..10000)
deconstruct_brep = DeconstructBrep(Brep=list_item_3)  # -> Faces, Edges, Vertices
get_object_by_nickname = GetObjectByNickname(NickName="阳台窗宽度")
list_item_4 = ListItem(List=cluster_6.faces, Index=cluster_6.index_2, Wrap=True)
offset_surface = OffsetSurface(Surface=cull_index_2, Distance=外墙厚_2, BothSides=expr("-x", 外墙厚_2), CreateSolid=True)
unit_y = UnitY(Factor=ghpython_script_3)
curve_middle = CurveMiddle(Curve=deconstruct_brep.Edges)
get_objects_in_group = GetObjectsInGroup(Group=get_object_by_nickname)
offset_surface_2 = OffsetSurface(Surface=list_item_4, Distance=外墙厚_2, BothSides=expr("-x", 外墙厚_2), CreateSolid=True)
unit_x = UnitX(Factor=ghpython_script_6)
extrude_2 = Extrude(Base=list_item_4, Direction=expr("-x", unit_y))
deconstruct = Deconstruct(Point=curve_middle)  # -> XComponent, YComponent, ZComponent
min_max = MinMax(Number=deconstruct.XComponent)  # -> Minimum, Maximum
multiplication_6 = Multiplication(A=阳台窗宽_100, B=Slider(100, range=0..100))
阳台门高 = Slider(2100, range=0..10000)
unit_x_2 = UnitX(Factor=ghpython_script_6)
unit_y_2 = UnitY(Factor=ghpython_script_5)
member_index_2 = MemberIndex(Set=deconstruct.XComponent, Member=min_max.Minimum)  # -> Index, Count
unit_x_3 = UnitX(Factor=ghpython_script_6)
unit_y_3 = UnitY(Factor=ghpython_script_5)
unit_z_2 = UnitZ(Factor=阳台门高)
list_item_5 = ListItem(List=deconstruct_brep.Edges, Index=member_index_2.Index, Wrap=True)
number_slider_3 = Slider(0.001, range=0..0.001)
extrude_3 = Extrude(Base=list_item_5, Direction=expr("-x", unit_y_3))
extrude_4 = Extrude(Base=list_item_5, Direction=unit_x_3)
bounding_box = BoundingBox(Content=[extrude_4, extrude_3], Plane=PlaneXY(0, 0, 0), UnionBox=True)  # -> Box, Box_2
wc窗台 = Slider(1300, range=0..10000)
wc窗台_2 = Slider(1600, range=0..10000)
wc窗宽最小 = Slider(600, range=0..10000)
construct_domain = ConstructDomain(DomainStart=wc窗台, DomainEnd=wc窗台_2)
random = Random(Range=construct_domain, Number=1, Seed=sample_id)
subtraction = Subtraction(A=层高, B=Slider(600, range=0..1000))
unit_z_3 = UnitZ(Factor=Slider(0.01, range=0..0.01))
integer_2 = Integer(random)
subtraction_2 = Subtraction(A=subtraction, B=ghpython_script_8)
unit_z_4 = UnitZ(Factor=ghpython_script_8)
unit_z_5 = UnitZ(Factor=subtraction_2)
unit_z_6 = UnitZ(Factor=subtraction_2)

# ---- group: 模型生成过程 / 房间进深
integer_3 = Integer(cluster_2)

# ---- group: 模型生成过程 / 阳台进深
integer_4 = Integer(cluster_3)

# ---- group: 模型生成过程 / 卫生间进深
integer_5 = Integer(cluster_4)

# ---- group: 模型生成过程 / 房间面宽
integer_6 = Integer(cluster)

# ---- group: 模型生成过程 / room
brep_2 = Brep(extrude)

# ---- group: 模型生成过程 / 阳台
brep_3 = Brep(extrude_2)

# ---- group: 模型生成过程
brep_4 = Brep(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)
cluster_7 = Cluster(relay_4=水平定位, relay_3=垂直定位, relay_2=z轴比例, relay=x轴比例, brep=brep_2)  # -> geometry, brep_3
cluster_8 = Cluster_3(relay=门的位置, brep=brep_2, S=relay)
cluster_9 = Cluster_4(scale_z=遮阳高度, relay=brep_3, relay_2=放缩)  # -> relay_5, relay_6, brep_2, i
point = Point(cluster_9.i)

# ---- group: 模型生成过程 / room
brep_5 = Brep(brep_2)

# ---- group: 模型生成过程 / door
brep_6 = Brep(cluster_8)

# ---- group: 模型生成过程 / shades
brep_7 = Brep(cluster_9.relay_5)

# ---- group: 模型生成过程 / 卫生间
brep_8 = Brep(bounding_box.Box)

# ---- group: 模型生成过程 (continued)
cluster_10 = Cluster_9(relay=门的位置, brep=brep_2, data=number_slider)  # -> geometry, crv_2
cluster_11 = Cluster(relay_4=水平定位, relay_3=垂直定位, relay_2=z轴比例, relay=x轴比例, brep=brep_2)  # -> geometry, brep_3
brep_9 = Brep(cluster_9.brep_2)
brep_10 = Brep(cluster_9.relay_6)
brep_join = BrepJoin(Breps=flatten(brep_10))  # -> Breps, Closed
brep_11 = Brep(cluster_11.brep_3)
deconstruct_brep_2 = DeconstructBrep(Brep=brep_11)  # -> Faces, Edges, Vertices
去顶底 = 去顶底(brep=brep_join.Breps)
curve = Curve(cluster_10.crv_2)
brep_12 = Brep(去顶底)
offset_surface_3 = OffsetSurface(Surface=flatten(brep_12), Distance=外墙厚_2, BothSides=expr("-x", 外墙厚_2), CreateSolid=True)
curve_middle_2 = CurveMiddle(Curve=deconstruct_brep_2.Edges)
end_points = EndPoints(Curve=curve)  # -> Start, End
point_2 = Point(end_points.Start)
deconstruct_2 = Deconstruct(Point=curve_middle_2)  # -> XComponent, YComponent, ZComponent
move = Move(Geometry=point_2, Motion=unit_x)  # -> Geometry, Transform
offset_surface_4 = OffsetSurface(Surface=brep_6, Distance=外墙厚_2, BothSides=expr("-x", 外墙厚_2), CreateSolid=True)
min_max_2 = MinMax(Number=deconstruct_2.XComponent)  # -> Minimum, Maximum
line = Line(StartPoint=move.Geometry, EndPoint=end_points.End)
length = Length(Curve=line)
subtraction_3 = Subtraction(A=length, B=Slider(500, range=0..1000))
construct_domain_2 = ConstructDomain(DomainStart=阳台窗宽最小_100, DomainEnd=subtraction_3)
division = Division(A=subtraction_3, B=Slider(100, range=0..100))
random_2 = Random(Range=construct_domain_2, Number=1, Seed=sample_id)
set_slider_properties = SetSliderProperties(Slider=get_objects_in_group, Range=construct_domain_2, Type=1)
min_max_3 = MinMax(Number=flatten([ghpython_script_4, subtraction_3]))  # -> Minimum, Maximum
member_index_3 = MemberIndex(Set=deconstruct_2.XComponent, Member=min_max_2.Minimum)  # -> Index, Count
curve_middle_3 = CurveMiddle(Curve=line)
list_item_6 = ListItem(List=deconstruct_brep_2.Edges, Index=member_index_3.Index, Wrap=True)
scale_to_length = ScaleToLength(Curve=line, Plane=curve_middle_3, Length=min_max_3.Minimum, FactorX=1, FactorY=1, FactorZ=1)  # -> Scaled, Transform
extrude_5 = Extrude(Base=list_item_6, Direction=unit_x_2)
extrude_6 = Extrude(Base=list_item_6, Direction=unit_y_2)
extrude_7 = Extrude(Base=scale_to_length.Scaled, Direction=unit_z_2)
bounding_box_2 = BoundingBox(Content=[extrude_5, extrude_6], Plane=PlaneXY(0, 0, 0), UnionBox=True)  # -> Box, Box_2
scale_4 = Scale(Geometry=brep_5, Center=Point(0, 0, 0), Factor=number_slider_3)  # -> flatten(Geometry), Transform
scale_5 = Scale(Geometry=brep_10, Center=Point(0, 0, 0), Factor=number_slider_3)  # -> flatten(Geometry), Transform
scale_6 = Scale(Geometry=brep_6, Center=Point(0, 0, 0), Factor=number_slider_3)  # -> flatten(Geometry), Transform

# ---- group: 模型生成过程 / window
brep_13 = Brep(extrude_7)

# ---- group: 模型生成过程 / 窗宽
integer_7 = Integer(random_2)

# ---- group: 模型生成过程 / 卫生间
brep_14 = Brep(bounding_box_2.Box)

# ---- group: 模型生成过程 (continued)
area_2 = Area(Geometry=brep_13)  # -> Area, Centroid
scale_nu = ScaleNU(Geometry=brep_13, Plane=area_2.Centroid, ScaleX=通风最大开窗比, ScaleY=1, ScaleZ=1)  # -> Geometry, Transform
offset_surface_5 = OffsetSurface(Surface=brep_13, Distance=外墙厚_2, BothSides=expr("-x", 外墙厚_2), CreateSolid=True)
solid_difference = SolidDifference(BrepsA=offset_surface_2, BrepsB=offset_surface_5)
scale_7 = Scale(Geometry=brep_13, Center=Point(0, 0, 0), Factor=number_slider_3)  # -> flatten(Geometry), Transform
scale_8 = Scale(Geometry=brep_14, Center=Point(0, 0, 0), Factor=number_slider_3)  # -> flatten(Geometry), Transform
cluster_12 = Cluster_9(relay=门的位置, brep=brep_14, data=number_slider)  # -> geometry, crv_2
cluster_13 = Cluster_10(brep=brep_14, D=厕所墙厚_2, B=厕所墙厚_2)  # -> E, i, O
length_2 = Length(Curve=cluster_12.crv_2)
brep_15 = Brep(scale_7.Geometry)
deconstruct_brep_3 = DeconstructBrep(Brep=brep_14)  # -> Faces, Edges, Vertices
subtraction_4 = Subtraction(A=length_2, B=Slider(500, range=0..1000))
brep_16 = Brep(cluster_13.i)
construct_domain_3 = ConstructDomain(DomainStart=wc窗宽最小, DomainEnd=subtraction_4)
list_item_7 = ListItem(List=brep_16, Index=1, Wrap=True)
list_item_8 = ListItem(List=brep_16, Index=0, Wrap=True)
area_3 = Area(Geometry=deconstruct_brep_3.Faces)  # -> Area, Centroid
min_max_4 = MinMax(Number=flatten([ghpython_script_7, subtraction_4]))  # -> Minimum, Maximum
random_3 = Random(Range=construct_domain_3, Number=1, Seed=sample_id)
deconstruct_3 = Deconstruct(Point=area_3.Centroid)  # -> XComponent, YComponent, ZComponent
curve_middle_4 = CurveMiddle(Curve=cluster_12.crv_2)
integer_8 = Integer(random_3)
min_max_5 = MinMax(Number=deconstruct_3.XComponent)  # -> Minimum, Maximum
scale_to_length_2 = ScaleToLength(Curve=cluster_12.crv_2, Plane=curve_middle_4, Length=min_max_4.Minimum, FactorX=1, FactorY=1, FactorZ=1)  # -> Scaled, Transform
member_index_4 = MemberIndex(Set=deconstruct_3.XComponent, Member=min_max_5.Maximum)  # -> Index, Count
extrude_8 = Extrude(Base=scale_to_length_2.Scaled, Direction=unit_z_5)
move_2 = Move(Geometry=scale_to_length_2.Scaled, Motion=unit_z_4)  # -> Geometry, Transform
cull_index_3 = CullIndex(List=deconstruct_brep_3.Faces, Indices=member_index_4.Index, Wrap=True)
list_item_9 = ListItem(List=deconstruct_brep_3.Faces, Index=member_index_4.Index, Wrap=True)

# ---- group: 模型生成过程 / 通风开窗
brep_17 = Brep(scale_nu.Geometry)

# ---- group: 模型生成过程 / 厕所门
brep_18 = Brep(cluster_13.E)

# ---- group: 模型生成过程 / 窗
extrude_9 = Extrude(Base=move_2.Geometry, Direction=unit_z_6)

# ---- group: 模型生成过程 / wc窗
brep_19 = Brep(extrude_9)

# ---- group: 模型生成过程 (continued)
offset_surface_6 = OffsetSurface(Surface=brep_19, Distance=外墙厚_2, BothSides=expr("-x", 外墙厚_2), CreateSolid=True)
offset_surface_7 = OffsetSurface(Surface=brep_17, Distance=外墙厚_2, BothSides=expr("-x", 外墙厚_2), CreateSolid=True)
solid_difference_2 = SolidDifference(BrepsA=offset_surface_2, BrepsB=offset_surface_7)
scale_9 = Scale(Geometry=brep_19, Center=Point(0, 0, 0), Factor=number_slider_3)  # -> flatten(Geometry), Transform
scale_10 = Scale(Geometry=brep_18, Center=Point(0, 0, 0), Factor=number_slider_3)  # -> flatten(Geometry), Transform
offset_surface_8 = OffsetSurface(Surface=brep_18, Distance=厕所墙厚_2, BothSides=expr("-x", 厕所墙厚_2), CreateSolid=True)
solid_difference_3 = SolidDifference(BrepsA=cluster_13.O, BrepsB=offset_surface_8)
solid_union = SolidUnion(Breps=flatten([solid_difference_3, offset_surface_3, offset_surface, solid_difference_2]))
solid_union_2 = SolidUnion(Breps=flatten([solid_difference_3, offset_surface_3, offset_surface, solid_difference]))
brep_20 = Brep(solid_union_2)
solid_difference_4 = SolidDifference(BrepsA=brep_20, BrepsB=offset_surface_4)
solid_difference_5 = SolidDifference(BrepsA=solid_difference_4, BrepsB=offset_surface_6)
move_3 = Move(Geometry=brep_18, Motion=unit_z_3)  # -> Geometry, Transform
region_difference = RegionDifference(CurvesA=list_item_9, CurvesB=brep_18)
brep_21 = Brep(flatten([region_difference, list_item_8]))
brep_join_2 = BrepJoin(Breps=[brep_5, brep_21])  # -> Breps, Closed
brep_join_3 = BrepJoin(Breps=[cull_index_3, brep_21])  # -> Breps, Closed

# ---- group: 模型生成过程 / 通风壁面
brep_22 = Brep(solid_union)

# ---- group: 模型生成过程 (continued)
bounding_box_3 = BoundingBox(Content=brep_22, Plane=PlaneXY(0, 0, 0), UnionBox=True)  # -> Box, Box_2
cluster_14 = Cluster_11(brep=bounding_box_3.Box)  # -> i, i_2

# ---- group: 模型生成过程 / 通风底面
brep_23 = Brep(cluster_14.i)

# ---- group: 模型生成过程 / 通风顶面
brep_24 = Brep(cluster_14.i_2)

# ---- group: 模型生成过程
主体 = Scale(Geometry=solid_difference_5, Center=Point(0, 0, 0), Factor=number_slider_3)  # -> flatten(Geometry), Transform
底面 = Scale(Geometry=brep_23, Center=Point(0, 0, 0), Factor=number_slider_3)  # -> flatten(Geometry), Transform
顶面 = Scale(Geometry=brep_24, Center=Point(0, 0, 0), Factor=number_slider_3)  # -> flatten(Geometry), Transform

brep_join_4 = BrepJoin(Breps=flatten([主体.Geometry, 底面.Geometry, 顶面.Geometry]))  # -> flatten(Breps), Closed

# ----
breps = ClusterOutput(brep_join_4.Breps)

# ==== cluster Cluster
brep = ClusterInput()
deconstruct_brep = DeconstructBrep(Brep=brep)  # -> Faces, Edges, Vertices
area = Area(Geometry=deconstruct_brep.Faces)  # -> Area, Centroid
deconstruct = Deconstruct(Point=area.Centroid)  # -> XComponent, YComponent, ZComponent
min_max = MinMax(Number=deconstruct.XComponent)  # -> Minimum, Maximum
min_max_2 = MinMax(Number=deconstruct.YComponent)  # -> Minimum, Maximum
member_index = MemberIndex(Set=deconstruct.YComponent, Member=min_max_2.Minimum)  # -> Index, Count
min_max_3 = MinMax(Number=deconstruct.ZComponent)  # -> Minimum, Maximum
relay = ClusterInput()
relay_2 = ClusterInput()
relay_3 = ClusterInput()
relay_4 = ClusterInput()
list_item = ListItem(List=deconstruct_brep.Faces, Index=member_index.Index, Wrap=True)
subtraction = Subtraction(A=min_max_3.Maximum, B=min_max_3.Minimum)
subtraction_2 = Subtraction(A=min_max.Maximum, B=min_max.Minimum)
number_slider = Slider(0.99, range=0.5..0.99)
subtraction_3 = Subtraction(A=Slider(1, range=0..1), B=relay)
area_2 = Area(Geometry=list_item)  # -> Area, Centroid
subtraction_4 = Subtraction(A=Slider(1, range=0..1), B=relay_2)
scale_nu = ScaleNU(Geometry=list_item, Plane=area_2.Centroid, ScaleX=number_slider, ScaleY=1, ScaleZ=number_slider)  # -> Geometry, Transform
multiplication = Multiplication(A=subtraction, B=subtraction_4)
deconstruct_2 = Deconstruct(Point=area_2.Centroid)  # -> XComponent, YComponent, ZComponent
move = Move(Motion=Vector(0, 0, 10))  # -> Geometry, Transform
multiplication_2 = Multiplication(A=multiplication, B=relay_3)
multiplication_3 = Multiplication(A=subtraction_2, B=subtraction_3)
division = Division(A=multiplication_3, B=2)
unit_z = UnitZ(Factor=multiplication_2)
construct_point = ConstructPoint(XCoordinate=deconstruct_2.XComponent, YCoordinate=deconstruct_2.YComponent, ZCoordinate=min_max_3.Minimum)
multiplication_4 = Multiplication(A=relay_4, B=multiplication_3)
subtraction_5 = Subtraction(A=multiplication_4, B=division)
scale_nu_2 = ScaleNU(Geometry=list_item, Plane=construct_point, ScaleX=relay, ScaleY=1, ScaleZ=relay_2)  # -> Geometry, Transform
move_2 = Move(Geometry=scale_nu_2.Geometry, Motion=unit_z)  # -> Geometry, Transform
unit_x = UnitX(Factor=subtraction_5)
move_3 = Move(Geometry=move_2.Geometry, Motion=unit_x)  # -> Geometry, Transform
brep_2 = Brep(list_item)
geometry = ClusterOutput(move_3.Geometry)
brep_3 = ClusterOutput(brep_2)

# ==== cluster Cluster_3
brep = ClusterInput()
deconstruct_brep = DeconstructBrep(Brep=brep)  # -> Faces, Edges, Vertices
S = ClusterInput()
area = Area(Geometry=deconstruct_brep.Faces)  # -> Area, Centroid
deconstruct = Deconstruct(Point=area.Centroid)  # -> XComponent, YComponent, ZComponent
min_max = MinMax(Number=deconstruct.XComponent)  # -> Minimum, Maximum
min_max_2 = MinMax(Number=deconstruct.YComponent)  # -> Minimum, Maximum
member_index = MemberIndex(Set=deconstruct.YComponent, Member=min_max_2.Maximum)  # -> Index, Count
min_max_3 = MinMax(Number=deconstruct.ZComponent)  # -> Minimum, Maximum
relay = ClusterInput()
list_item = ListItem(List=deconstruct_brep.Faces, Index=member_index.Index, Wrap=True)
cluster = Cluster_2(brep=list_item)
subtraction = Subtraction(A=min_max_3.Maximum, B=min_max_3.Minimum)
subtraction_2 = Subtraction(A=min_max.Maximum, B=min_max.Minimum)
阳台窗宽 = Slider(15, range=0..10000)
number_slider = Slider(100, range=0..100)
len = Length(Curve=cluster)
end = EndPoints(Curve=cluster)  # -> Start, End
subtraction_3 = Subtraction(A=len, B=Slider(1000, range=0..1000))
area_2 = Area(Geometry=list_item)  # -> Area, Centroid
pt = Point(end.End)
pt_2 = Point(end.Start)
division = Division(A=subtraction_3, B=number_slider)
门宽 = Slider(900, range=0..1000)
dom = ConstructDomain(DomainStart=阳台窗宽, DomainEnd=division)
X = UnitX(Factor=Slider(600, range=0..1000))
X_2 = UnitX(Factor=Slider(600, range=0..1000))
random = Random(Range=dom, Number=1, Seed=2)
move = Move(Geometry=pt, Motion=X)  # -> Geometry, Transform
门高 = Slider(2100, range=0..10000)
move_2 = Move(Geometry=pt_2, Motion=expr("-x", X_2))  # -> Geometry, Transform
int = Integer(random)
multiplication = Multiplication(A=int, B=number_slider)
dom_2 = ConstructDomain(DomainStart=0, DomainEnd=1)
midpt = CurveMiddle(Curve=cluster)
ln = Line(StartPoint=move_2.Geometry, EndPoint=move.Geometry)
deconstruct_2 = Deconstruct(Point=area_2.Centroid)  # -> XComponent, YComponent, ZComponent
multiplication_2 = Multiplication()
random_2 = Random(Range=dom_2, Number=1, Seed=S)
Z = UnitZ(Factor=门高)
number_slider_2 = Slider(0.3, range=0..1)
eval = EvaluateCurve(Curve=ln, Parameter=random_2)  # -> Point, Tangent, Angle
construct_point = ConstructPoint(XCoordinate=deconstruct_2.XComponent, YCoordinate=deconstruct_2.YComponent, ZCoordinate=min_max_3.Minimum)
scale2len = ScaleToLength(Curve=cluster, Plane=eval.Point, Length=门宽, FactorX=1, FactorY=1, FactorZ=1)  # -> Scaled, Transform
scale_nu = ScaleNU(Geometry=list_item, Plane=construct_point, ScaleX=Slider(0.25, range=0..1), ScaleY=1, ScaleZ=Slider(0.6, range=0..1))  # -> Geometry, Transform
deconstuct_rectangle = DeconstuctRectangle(Rectangle=scale_nu.Geometry)  # -> BasePlane, XInterval, YInterval
number = Number(deconstuct_rectangle.YInterval)
subtraction_4 = Subtraction(A=subtraction_2, B=number)
multiplication_3 = Multiplication(A=relay, B=subtraction_4)
division_2 = Division(A=subtraction_4, B=2)
subtraction_5 = Subtraction(A=multiplication_3, B=division_2)
unit_x = UnitX(Factor=subtraction_5)
move_3 = Move(Geometry=scale_nu.Geometry, Motion=unit_x)  # -> Geometry, Transform
extr = Extrude(Base=scale2len.Scaled, Direction=Z)
E = ClusterOutput(extr)

# ==== cluster Cluster_4
relay = ClusterInput()
relay_2 = ClusterInput()
deconstruct_brep = DeconstructBrep(Brep=relay)  # -> Faces, Edges, Vertices
deconstruct_brep_2 = DeconstructBrep(Brep=relay)  # -> Faces, Edges, Vertices
deconstruct = Deconstruct(Point=deconstruct_brep.Vertices)  # -> XComponent, YComponent, ZComponent
min_max = MinMax(Number=deconstruct.YComponent)  # -> Minimum, Maximum
area = Area(Geometry=deconstruct_brep_2.Faces)  # -> Area, Centroid
deconstruct_2 = Deconstruct(Point=area.Centroid)  # -> XComponent, YComponent, ZComponent
unit_y = UnitY(Factor=min_max.Maximum)
min_max_2 = MinMax(Number=deconstruct_2.YComponent)  # -> Minimum, Maximum
min_max_3 = MinMax(Number=deconstruct_2.ZComponent)  # -> Minimum, Maximum
scale_nu = ScaleNU(Geometry=relay, Plane=unit_y, ScaleX=1, ScaleY=relay_2, ScaleZ=1)  # -> Geometry, Transform
min_max_4 = MinMax(Number=deconstruct_2.YComponent)  # -> Minimum, Maximum
member_index = MemberIndex(Set=deconstruct_2.YComponent, Member=min_max_2.Maximum)  # -> Index, Count
unit_z = UnitZ(Factor=min_max_3.Maximum)
member_index_2 = MemberIndex(Set=deconstruct_2.YComponent, Member=min_max_4.Minimum)  # -> Index, Count
list_item = ListItem(List=deconstruct_brep_2.Faces, Index=member_index.Index, Wrap=True)
construct_plane = ConstructPlane(Origin=unit_z, XAxis=Vector(1, 0, 0), YAxis=Vector(0, 1, 0))
list_item_2 = ListItem(List=deconstruct_brep_2.Faces, Index=member_index_2.Index, Wrap=True)
explode = Explode(Curve=list_item_2, Recursive=True)  # -> Segments, Vertices
cull_index = CullIndex(List=deconstruct_brep_2.Faces, Indices=member_index_2.Index, Wrap=True)
curve_middle = CurveMiddle(Curve=explode.Segments)
cull_index_2 = CullIndex(List=deconstruct_brep_2.Faces, Indices=[member_index.Index, member_index_2.Index], Wrap=True)
scale_z = ClusterInput()
deconstruct_3 = Deconstruct(Point=curve_middle)  # -> XComponent, YComponent, ZComponent
scale_nu_2 = ScaleNU(Geometry=list_item_2, Plane=construct_plane, ScaleX=1, ScaleY=1, ScaleZ=scale_z)  # -> Geometry, Transform
min_max_5 = MinMax(Number=deconstruct_3.ZComponent)  # -> Minimum, Maximum
scale_nu_3 = ScaleNU(Geometry=list_item_2, Plane=PlaneXY(0, 0, 0), ScaleX=1, ScaleY=1, ScaleZ=Slider(0.3, range=0..1))  # -> Geometry, Transform
member_index_3 = MemberIndex(Set=deconstruct_3.ZComponent, Member=min_max_5.Minimum)  # -> Index, Count
list_item_3 = ListItem(List=curve_middle, Index=member_index_3.Index, Wrap=True)
brep = Brep(scale_nu_3.Geometry)
relay_3 = Relay([scale_nu_2.Geometry, scale_nu_3.Geometry, cull_index])
relay_4 = Relay([scale_nu_2.Geometry, scale_nu_3.Geometry, cull_index_2])
brep_2 = ClusterOutput(brep)
i = ClusterOutput(list_item_3)
relay_5 = ClusterOutput(relay_3)
relay_6 = ClusterOutput(relay_4)

# ==== cluster 建筑类型1
输入曲线 = ClusterInput()
倒角半径 = ClusterInput()
relay = ClusterInput()
relay_2 = ClusterInput()
relay_3 = ClusterInput()
relay_4 = ClusterInput()
relay_5 = ClusterInput()
relay_6 = ClusterInput()
relay_7 = ClusterInput()
底层高度 = ClusterInput()
底层内收距离 = ClusterInput()
offset_curve = OffsetCurve(Curve=输入曲线, Plane=PlaneXY(0, 0, 0), Distance=expr("-x*1000", relay_3), BothSides=0, Kinks=0, CapType=1)
explode = Explode(Curve=offset_curve, Recursive=True)  # -> Segments, Vertices
dispatch = Dispatch(List=explode.Segments, DispatchPattern=[True, False])  # -> ListA, ListB
cluster = Cluster_5(relay_2=dispatch.ListB, relay=relay_6, B=relay_7)
cluster_2 = Cluster_5(relay_2=dispatch.ListA, relay=relay_4, B=relay_5)
cluster_3 = Cluster_7(list=cluster_2)
cluster_4 = Cluster_7(list=cluster)
loft = Loft(Curves=cluster_4, Options={Adjust=False, Closed=False, LoftEnds=0, LoftSimp=0, LoftType=0, Rebuild=10, Refit=0.01})
loft_2 = Loft(Curves=cluster_3, Options={Adjust=False, Closed=False, LoftEnds=0, LoftSimp=0, LoftType=0, Rebuild=10, Refit=0.01})
boundary_surfaces = BoundarySurfaces(Edges=offset_curve)
cluster_5 = Cluster_6(relay=boundary_surfaces, relay_2=loft_2)
cluster_6 = Cluster_6(relay=boundary_surfaces, relay_2=loft)
region_difference = RegionDifference(CurvesA=boundary_surfaces, CurvesB=cluster_5)
region_difference_2 = RegionDifference(CurvesA=region_difference, CurvesB=cluster_6)
multiplication = Multiplication(A=relay, B=relay_2)
cluster_7 = Cluster_8(curve=region_difference_2, radius=倒角半径, 底层高度=底层高度, 底层内收距离=底层内收距离)  # -> curve_2, unit_vector, extrusion
unit_z = UnitZ(Factor=multiplication)
extrude = Extrude(Base=cluster_7.curve_2, Direction=unit_z)
move = Move(Geometry=extrude, Motion=cluster_7.unit_vector)  # -> Geometry, Transform
geometry = ClusterOutput(move.Geometry)
extrusion = ClusterOutput(cluster_7.extrusion)

# ==== cluster Cluster_9
brep = ClusterInput()
data = ClusterInput()
deconstruct_brep = DeconstructBrep(Brep=brep)  # -> Faces, Edges, Vertices
area = Area(Geometry=deconstruct_brep.Faces)  # -> Area, Centroid
data_2 = Data()
deconstruct = Deconstruct(Point=area.Centroid)  # -> XComponent, YComponent, ZComponent

# ---- group: 阳台窗宽度
阳台窗宽_100 = Slider(15, range=10..15)

# ----
阳台窗宽最小_100 = Slider(15, range=0..10000)
min_max = MinMax(Number=deconstruct.YComponent)  # -> Minimum, Maximum
member_index = MemberIndex(Set=deconstruct.YComponent, Member=min_max.Minimum)  # -> Index, Count
objbynn = GetObjectByNickname(NickName="阳台窗宽度")
min_max_2 = MinMax(Number=deconstruct.XComponent)  # -> Minimum, Maximum
min_max_3 = MinMax(Number=deconstruct.ZComponent)  # -> Minimum, Maximum
relay = ClusterInput()
objfromgroup = GetObjectsInGroup(Group=objbynn)
list_item = ListItem(List=deconstruct_brep.Faces, Index=member_index.Index, Wrap=True)
cluster = Cluster_2(brep=list_item)
len = Length(Curve=cluster)
subtraction = Subtraction(A=len, B=Slider(1000, range=0..1000))
division = Division(A=subtraction, B=Slider(100, range=0..100))
dom = ConstructDomain(DomainStart=阳台窗宽最小_100, DomainEnd=division)
random = Random(Range=dom, Number=1, Seed=data_2)
int = Integer(random)
subtraction_2 = Subtraction(A=min_max_3.Maximum, B=min_max_3.Minimum)
set_slider = SetSliderProperties(Slider=objfromgroup, Range=dom, Type=1)
subtraction_3 = Subtraction(A=min_max_2.Maximum, B=min_max_2.Minimum)
number_slider = Slider(0.99, range=0.5..0.99)
midpt = CurveMiddle(Curve=cluster)
multiplication = Multiplication(A=阳台窗宽_100, B=Slider(100, range=0..100))
area_2 = Area(Geometry=list_item)  # -> Area, Centroid
阳台门高 = Slider(2100, range=0..10000)
scale2len = ScaleToLength(Curve=cluster, Plane=midpt, Length=multiplication, FactorX=1, FactorY=1, FactorZ=1)  # -> Scaled, Transform
scale_nu = ScaleNU(Geometry=list_item, Plane=area_2.Centroid, ScaleX=number_slider, ScaleY=1, ScaleZ=number_slider)  # -> Geometry, Transform; disabled
Z = UnitZ(Factor=阳台门高)
extr = Extrude(Base=scale2len.Scaled, Direction=Z)
deconstruct_2 = Deconstruct(Point=area_2.Centroid)  # -> XComponent, YComponent, ZComponent
multiplication_2 = Multiplication()
construct_point = ConstructPoint(XCoordinate=deconstruct_2.XComponent, YCoordinate=deconstruct_2.YComponent, ZCoordinate=min_max_3.Minimum)
scale_nu_2 = ScaleNU(Geometry=list_item, Plane=construct_point, ScaleX=Slider(0.3, range=0..1), ScaleY=1, ScaleZ=Slider(0.7, range=0..1))  # -> Geometry, Transform
deconstuct_rectangle = DeconstuctRectangle(Rectangle=scale_nu_2.Geometry)  # -> BasePlane, XInterval, YInterval
number = Number(deconstuct_rectangle.YInterval)
subtraction_4 = Subtraction(A=subtraction_3, B=number)
division_2 = Division(A=subtraction_4, B=2)
multiplication_3 = Multiplication(A=relay, B=subtraction_4)
subtraction_5 = Subtraction(A=multiplication_3, B=division_2)
unit_x = UnitX(Factor=subtraction_5)
crv = Curve(cluster)
move = Move(Geometry=scale_nu_2.Geometry, Motion=unit_x)  # -> Geometry, Transform
brep_2 = Brep(extr)
crv_2 = ClusterOutput(crv)
geometry = ClusterOutput(move.Geometry)

# ==== cluster Cluster_10
brep = ClusterInput()
deconstruct_brep = DeconstructBrep(Brep=brep)  # -> Faces, Edges, Vertices
area = Area(Geometry=deconstruct_brep.Faces)  # -> Area, Centroid
deconstruct = Deconstruct(Point=area.Centroid)  # -> XComponent, YComponent, ZComponent
area_2 = Area(Geometry=deconstruct_brep.Faces)  # -> Area, Centroid
min_max = MinMax(Number=deconstruct.YComponent)  # -> Minimum, Maximum
deconstruct_2 = Deconstruct(Point=area_2.Centroid)  # -> XComponent, YComponent, ZComponent
member_index = MemberIndex(Set=deconstruct.YComponent, Member=min_max.Maximum)  # -> Index, Count
min_max_2 = MinMax(Number=deconstruct_2.XComponent)  # -> Minimum, Maximum
member_index_2 = MemberIndex(Set=deconstruct_2.XComponent, Member=min_max_2.Maximum)  # -> Index, Count
list_item = ListItem(List=deconstruct_brep.Faces, Index=[member_index.Index, member_index_2.Index], Wrap=True)
list_item_2 = ListItem(List=deconstruct_brep.Faces, Index=member_index_2.Index, Wrap=True)
cull_i = CullIndex(List=deconstruct_brep.Faces, Wrap=True)
厕所门宽 = Slider(700, range=0..1000)
D = ClusterInput()
B = ClusterInput()
join = BrepJoin(Breps=list_item)  # -> Breps, Closed
cluster = Cluster_2(brep=list_item_2)
门高 = Slider(2100, range=0..10000)
offsrf = OffsetSurface(Surface=join.Breps, Distance=D, BothSides=expr("-x", B), CreateSolid=True)
midpt = CurveMiddle(Curve=cluster)
scale2len = ScaleToLength(Curve=cluster, Plane=midpt, Length=厕所门宽, FactorX=1, FactorY=1, FactorZ=1)  # -> Scaled, Transform
i = ClusterOutput(list_item)
O = ClusterOutput(offsrf)
Z = UnitZ(Factor=门高)
extr = Extrude(Base=scale2len.Scaled, Direction=Z)
E = ClusterOutput(extr)

# ==== cluster 去顶底
brep = ClusterInput()
deconstruct_brep = DeconstructBrep(Brep=flatten(brep))  # -> Faces, Edges, Vertices
area = Area(Geometry=deconstruct_brep.Faces)  # -> Area, Centroid
deconstruct = Deconstruct(Point=area.Centroid)  # -> XComponent, YComponent, ZComponent
min_max = MinMax(Number=deconstruct.ZComponent)  # -> Minimum, Maximum
member_index = MemberIndex(Set=deconstruct.ZComponent, Member=[min_max.Minimum, min_max.Maximum])  # -> flatten(Index), Count
cull_i = CullIndex(List=deconstruct_brep.Faces, Indices=flatten(member_index.Index), Wrap=True)
L = ClusterOutput(cull_i)

# ==== cluster Cluster_11
brep = ClusterInput()
deconstruct_brep = DeconstructBrep(Brep=brep)  # -> Faces, Edges, Vertices
area = Area(Geometry=deconstruct_brep.Faces)  # -> Area, Centroid
deconstruct = Deconstruct(Point=area.Centroid)  # -> XComponent, YComponent, ZComponent
min_max = MinMax(Number=deconstruct.ZComponent)  # -> Minimum, Maximum
min_max_2 = MinMax(Number=deconstruct.ZComponent)  # -> Minimum, Maximum
member_index = MemberIndex(Set=deconstruct.ZComponent, Member=min_max.Minimum)  # -> flatten(Index), Count
member_index_2 = MemberIndex(Set=deconstruct.ZComponent, Member=min_max_2.Maximum)  # -> flatten(Index), Count
list_item = ListItem(List=deconstruct_brep.Faces, Index=member_index.Index, Wrap=True)
list_item_2 = ListItem(List=deconstruct_brep.Faces, Index=member_index_2.Index, Wrap=True)
i = ClusterOutput(list_item)
i_2 = ClusterOutput(list_item_2)

# ==== cluster Cluster_12
brep = ClusterInput()
deconstruct_brep = DeconstructBrep(Brep=brep)  # -> Faces, Edges, Vertices
area = Area(Geometry=deconstruct_brep.Faces)  # -> Area, Centroid
faces = ClusterOutput(deconstruct_brep.Faces)
deconstruct = Deconstruct(Point=area.Centroid)  # -> XComponent, YComponent, ZComponent
deconstruct_2 = Deconstruct(Point=area.Centroid)  # -> XComponent, YComponent, ZComponent
min_max = MinMax(Number=deconstruct.ZComponent)  # -> Minimum, Maximum
member_index = MemberIndex(Set=deconstruct.ZComponent, Member=[min_max.Minimum, min_max.Maximum])  # -> flatten(Index), Count
min_max_2 = MinMax(Number=deconstruct_2.YComponent)  # -> Minimum, Maximum
member_index_2 = MemberIndex(Set=deconstruct_2.YComponent, Member=min_max_2.Minimum)  # -> Index, Count
y_component = ClusterOutput(deconstruct_2.YComponent)
index = ClusterOutput(member_index.Index)
index_2 = ClusterOutput(member_index_2.Index)
maximum = ClusterOutput(min_max_2.Maximum)

# ==== cluster Cluster_13
A = ClusterInput()
B = ClusterInput()
dom = ConstructDomain(DomainStart=A, DomainEnd=B)
S = ClusterInput()
random = Random(Range=dom, Number=1, Seed=S)
R = ClusterOutput(random)

# ==== cluster Cluster_2
brep = ClusterInput()
deconstruct_brep = DeconstructBrep(Brep=brep)  # -> Faces, Edges, Vertices
midpt = CurveMiddle(Curve=deconstruct_brep.Edges)
deconstruct = Deconstruct(Point=midpt)  # -> XComponent, YComponent, ZComponent
min_max = MinMax(Number=deconstruct.ZComponent)  # -> Minimum, Maximum
member_index = MemberIndex(Set=deconstruct.ZComponent, Member=min_max.Minimum)  # -> Index, Count
list_item = ListItem(List=deconstruct_brep.Edges, Index=member_index.Index, Wrap=True)
i = ClusterOutput(list_item)

# ==== cluster Cluster_5
relay = ClusterInput()
relay_2 = ClusterInput()
length = Length(Curve=relay_2)
B = ClusterInput()
division = Division(A=length, B=relay)
multiplication = Multiplication(A=division, B=B)
series = Series(Start=graft(multiplication), Step=graft(multiplication), Count=expr("x-1", relay))
subtraction = Subtraction(A=relay, B=1)
subtraction_2 = Subtraction(A=division, B=multiplication)
multiplication_2 = Multiplication(A=relay, B=subtraction_2)
division_2 = Division(A=multiplication_2, B=subtraction)
series_2 = Series(Start=graft(0), Step=graft(division_2), Count=expr("x-1", relay))
addition = Addition(A=series, B=series_2)
addition_2 = Addition(A=addition, B=division_2)
merge = Merge(Data1=addition, Data2=addition_2)
shatter = Shatter(Curve=graft(relay_2), Parameters=merge)
segments = ClusterOutput(shatter)

# ==== cluster Cluster_6
relay = ClusterInput()
relay_2 = ClusterInput()
ghpython_script = GhPythonScript(tree=relay_2)  # -> out, a; inputs tree: tree
# ---------- ghpython_script: Python ----------
import Grasshopper.DataTree as DataTree
import Grasshopper.Kernel.Data.GH_Path as GH_Path

def count_tree_levels(tree):
    # 计算数据树的最大层数
    max_levels = 0
    for path in tree.Paths:
        # 将路径转换为字符串，并计算分号的数量
        path_str = path.ToString()
        levels = path_str.count(';') + 1
        max_levels = max(max_levels, levels)
    return max_levels

# 假设 'input_tree' 是从Grasshopper传入的数据树
# 你需要在Grasshopper中将一个数据树组件连接到这个脚本的输入

# 计算层数
levels = count_tree_levels(tree)

# 输出层数
a = levels
# ---------- end ghpython_script ----------
list_length = ListLength(List=flatten(relay))
subtraction = Subtraction(A=ghpython_script.a, B=1)
trim_tree = TrimTree(Tree=relay_2, Depth=subtraction)
ghpython_script_2 = GhPythonScript(num=list_length, x=flatten(relay_2), y=trim_tree)  # -> out, a; inputs x: list, y: tree
# ---------- ghpython_script_2: Python ----------
__author__ = "A"
__version__ = "2023.11.25"

import rhinoscriptsyntax as rs
if num == 1:
    a = x
else:
    a = y
# ---------- end ghpython_script_2 ----------
a = ClusterOutput(ghpython_script_2.a)

# ==== cluster Cluster_7
list = ClusterInput()
dispatch = Dispatch(List=simplify(list), DispatchPattern=[True, False])  # -> ListA, ListB
list_item = ListItem(List=dispatch.ListB, Index=0, Wrap=True)  # -> flatten(Item)
renumber_paths = RenumberPaths(Data=dispatch.ListB)
list_length = ListLength(List=list_item)
division = Division(A=list_length, B=2)
series = Series(Start=0, Step=2, Count=division)
tree_branch = TreeBranch(Tree=simplify(renumber_paths), Path=series, MaintainPaths=True)  # -> reverse(Branch)
flip_curve = FlipCurve(Curve=tree_branch)  # -> Curve, Flag
renumber_paths_2 = RenumberPaths(Data=flip_curve.Curve)
series_2 = Series(Start=Slider(1, range=0..1), Step=2, Count=division)
tree_branch_2 = TreeBranch(Tree=simplify(renumber_paths), Path=series_2, MaintainPaths=True)
renumber_paths_3 = RenumberPaths(Data=tree_branch_2)
merge = Merge(Data1=simplify(graft(renumber_paths_2)), Data2=simplify(graft(renumber_paths_3)))
result = ClusterOutput(merge)

# ==== cluster Cluster_8
底层高度 = ClusterInput()
底层内收距离 = ClusterInput()
unit_z = UnitZ(Factor=expr("1000*x", 底层高度))
curve = ClusterInput()
radius = ClusterInput()
fillet = Fillet(Curve=curve, Radius=expr("1000*x", radius))
unit_vector = ClusterOutput(unit_z)
curve_2 = ClusterOutput(fillet)
offset_curve = OffsetCurve(Curve=fillet, Plane=PlaneXY(0, 0, 0), Distance=expr("-x*1000", 底层内收距离), BothSides=0, Kinks=0, CapType=1)
extrude = Extrude(Base=offset_curve, Direction=unit_z)
extrusion = ClusterOutput(extrude)
